# Grasshopper definition voronoi_corridor.gh (Grasshopper 1.0.8)

R = Region({Plane=PlaneXY(142.3230128, 52.47345201, 0), Size=Domain2(u=-2068.383196..2068.383196, v=-1300.574282..1300.574282)})
box = CenterBox(Base=PlaneXY(0, 0, 0), X=1000, Y=1000, Z=1000)
pop2d = Populate2D(Region=R, Count=100, Seed=1)
pop3d = Populate3D(Region=box, Count=100, Seed=1)
voronoi³ = Voronoi3D(Points=pop2d)  # -> Cells, Boundary
planesrf = PlaneSurface(Plane=PlaneXY(0, 0, 0), XSize=Domain(-1000, 1000), YSize=Domain(-1000, 1000))
area = Area(Geometry=voronoi³.Cells)  # -> Area, Centroid
scale = Scale(Geometry=voronoi³.Cells, Center=area.Centroid, Factor=0.9)  # -> Geometry, Transform
trim = TrimSolid(Shape=planesrf, Cutters=scale.Geometry)
